test file "integration"

suite "New Test Suite 1"

  case "Change Power While Waiting" [baseline]
    model InductionCooker, harness test_integration_changepowerwhilewaiting
    test sequence scenario: ChangePowerWhileWaiting (test_integration_changepowerwhilewaiting/Test Sequence)

  case "Decrease Power" [baseline]
    model InductionCooker, harness test_integration_decrease_power
    test sequence scenario: DecreasePower (test_integration_decrease_power/Test Sequence)

  case "Increase Power" [baseline]
    model InductionCooker, harness test_integration_increase_power
    test sequence scenario: IncreasePower (test_integration_increase_power/Test Sequence)

  case "Increase and Decrease Power both Pressed" [baseline]
    model InductionCooker, harness test_integration_increaseanddecreasebothpressed
    test sequence scenario: IncreaseAndDecreaseBothPressed (test_integration_increaseanddecreasebothpressed/Test Sequence)

  case "Pot Removed While Cooking" [baseline]
    model InductionCooker, harness test_integration_potremovedwhilecooking
    test sequence scenario: PotRemovedWhileCooking (test_integration_potremovedwhilecooking/Test Sequence)

  case "Turn On Off" [baseline]
    model InductionCooker, harness test_integration_turnonoff
    test sequence scenario: TurnOnOff (test_integration_turnonoff/Test Sequence)